# Grasshopper definition Grasshopper.gh (Grasshopper 1.0.7)

number_slider = Slider(50, range=0..100)
crv = Curve(<curve referenced from the Rhino model>)
area = Area(Geometry=crv)  # -> Area, Centroid
pframes = PerpFrames(Curve=crv, Count=number_slider, Align=True)  # -> Frames, Parameters
scale = Scale(Geometry=crv, Center=area.Centroid, Factor=Slider(0.45, range=0..1))  # -> Geometry, Transform
dispatch = Dispatch(List=pframes.Frames, DispatchPattern=[True, False])  # -> ListA, ListB
pln = Plane(dispatch.ListB)
pframes_2 = PerpFrames(Curve=scale.Geometry, Count=number_slider, Align=True)  # -> Frames, Parameters
deplane = DeconstructPlane(Plane=pln)  # -> Origin, XAxis, YAxis, ZAxis
dispatch_2 = Dispatch(List=pframes_2.Frames, DispatchPattern=[True, False])  # -> ListA, ListB
pln_2 = Plane(dispatch_2.ListB)
deplane_2 = DeconstructPlane(Plane=pln_2)  # -> Origin, XAxis, YAxis, ZAxis
multiplication = Multiplication(A=deplane.XAxis, B=Slider(2.11, range=0..10))
multiplication_2 = Multiplication(A=Slider(39.87, range=0..100), B=deplane_2.YAxis)
bzspan = BezierSpan(StartPoint=deplane_2.Origin, StartTangent=multiplication_2, EndPoint=deplane.Origin, EndTangent=multiplication)  # -> Curve, Length, Domain

number_slider_2 = Slider(14, range=0..100)
pln_3 = Plane(pln)
vec = Vector(deplane_2.ZAxis)
crv_2 = Curve(bzspan.Curve)
pframes_3 = PerpFrames(Curve=crv_2, Count=number_slider_2, Align=True)  # -> Frames, Parameters
series = Series(Start=Slider(0.1, range=0..0.1), Step=Slider(0.34, range=0..1), Count=expr("x+1", number_slider_2))
deplane_3 = DeconstructPlane(Plane=PlaneXY(0, 0, 0))  # -> Origin, XAxis, YAxis, ZAxis
vpipe = PipeVariable(Curve=reparameterize(crv_2), Parameters=[0, 1], Radii=[0, 1], Caps=0)
multiplication_3 = Multiplication(A=deplane_3.ZAxis, B=series)
move = Move(Geometry=pframes_3.Frames, Motion=multiplication_3)  # -> Geometry, Transform
brep = Brep(vpipe)
pt = Point(graft(pln_3))
vec_2 = Vector(graft(vec))
number_slider_3 = Slider(180, range=0..1000)
cir = Circle(Plane=move.Geometry, Radius=series)
number_slider_4 = Slider(0, range=0..180)
srf = Surface(cir)
rot3d = Rotate3D(Geometry=srf, Angle=degrees(number_slider_3), Center=pt, Axis=vec_2)  # -> Geometry, Transform
rot3d_2 = Rotate3D(Geometry=brep, Angle=degrees(number_slider_3), Center=pt, Axis=vec_2)  # -> Geometry, Transform
rot3d_3 = Rotate3D(Geometry=brep, Angle=degrees(number_slider_4), Center=pt, Axis=vec_2)  # -> Geometry, Transform
rot3d_4 = Rotate3D(Geometry=rot3d_2.Geometry, Angle=degrees(number_slider_4), Center=pt, Axis=vec_2)  # -> Geometry, Transform
rot3d_5 = Rotate3D(Geometry=srf, Angle=degrees(number_slider_4), Center=pt, Axis=vec_2)  # -> Geometry, Transform
rot3d_6 = Rotate3D(Geometry=rot3d.Geometry, Angle=degrees(number_slider_4), Center=pt, Axis=vec_2)  # -> Geometry, Transform
