# Grasshopper definition Parametric Laser.gh (Grasshopper 1.0.7)

notch = Curve([<curve referenced from the Rhino model> x2])
bbox = BoundingBox(Content=notch, Plane=PlaneXY(0, 0, 0), UnionBox=True)  # -> Box, Box_2
debrep = DeconstructBrep(Brep=bbox.Box)  # -> Faces, Edges, Vertices
evalsrf = EvaluateSurface(Surface=reparameterize(debrep.Faces), Point="{0.0, 0.5, 0.0}")  # -> Point, Normal, UDirection, VDirection, Frame
cir = Circle(Plane=PlaneXY(0, 0, 0), Radius=Slider(30, range=0..100))
crv = Curve(cir)
crv_2 = Curve(<curve referenced from the Rhino model>)
series = Series(Start=0, Step=33.33333333, Count=3)
hframe = HorizontalFrame(Curve=reparameterize(cir), Parameter=series)
prot = RotatePlane(Plane=hframe, Angle=1.570796327)
orient = Orient(Geometry=notch, Source=evalsrf.Frame, Target=graft(prot))  # -> flatten(Geometry), Transform
rdiff = RegionDifference(CurvesA=crv_2, CurvesB=orient.Geometry)
arrrec = RectangularArray(Geometry=rdiff, Cell=crv, XCount=Slider(5, range=0..10), YCount=Slider(4, range=0..10))  # -> Geometry, Transform

notch_2 = Curve([<curve referenced from the Rhino model> x2])
bbox_2 = BoundingBox(Content=notch_2, Plane=PlaneXY(0, 0, 0), UnionBox=True)  # -> Box, Box_2
debrep_2 = DeconstructBrep(Brep=bbox_2.Box)  # -> Faces, Edges, Vertices
evalsrf_2 = EvaluateSurface(Surface=reparameterize(debrep_2.Faces), Point="{0.0, 0.5, 0.0}")  # -> Point, Normal, UDirection, VDirection, Frame
number_slider = Slider(20, range=0..100)
number_slider_2 = Slider(20, range=0..100)
dom = ConstructDomain(DomainStart=expr("-x", number_slider), DomainEnd=number_slider)
dom_2 = ConstructDomain(DomainStart=expr("-x", number_slider_2), DomainEnd=number_slider_2)
rectangle = Rectangle(Plane=PlaneXY(0, 0, 0), XSize=dom_2, YSize=dom, Radius=0)  # -> Rectangle, Length
crv_3 = Curve(rectangle.Rectangle)
explode = Explode(Curve=rectangle.Rectangle, Recursive=True)  # -> Segments, Vertices
hframe_2 = HorizontalFrame(Curve=reparameterize(explode.Segments), Parameter=Slider(0.5, range=0..1))
prot_2 = RotatePlane(Plane=hframe_2, Angle=1.570796327)
orient_2 = Orient(Geometry=notch_2, Source=evalsrf_2.Frame, Target=graft(prot_2))  # -> flatten(Geometry), Transform
rdiff_2 = RegionDifference(CurvesA=crv_3, CurvesB=orient_2.Geometry)
arrrec_2 = RectangularArray(Geometry=rdiff_2, Cell=rectangle.Rectangle, XCount=6, YCount=3)  # -> Geometry, Transform
